# Grasshopper definition spinTopLamp.gh (Grasshopper 1.0.7)

# ---- group: Inputs
radius = Slider(1, range=0.1..5)
edge_length = Slider(10, range=8..35)
approx_height = Slider(13, range=10..45)
endplate_rotation = Slider(100, range=-180..180)
number_of_slats = Slider(20, range=4..20)
socket_diameter = Slider(4.2, range=3.5..5)
number_slider = Slider(1, range=0..10)
fastener_diameter = Slider(0.6, range=0.2..1.2)
number_slider_2 = Slider(4, range=0..10)
number_slider_3 = Slider(3, range=0..10)

# ---- group: Base geometry
rectangle = Rectangle(Plane=PlaneXY(0, 0, 0), XSize=edge_length, YSize=edge_length, Radius=radius)  # -> Rectangle, Length
division = Division(A=edge_length, B=2)
X = UnitX(Factor=expr("-x", division))
Y = UnitY(Factor=expr("-x", division))
move = Move(Geometry=rectangle.Rectangle, Motion=X)  # -> Geometry, Transform
move_2 = Move(Geometry=move.Geometry, Motion=Y)  # -> Geometry, Transform
division_2 = Division(A=socket_diameter, B=2)
division_3 = Division(A=edge_length, B=2)
area = Area(Geometry=move_2.Geometry)  # -> Area, Centroid
cir = Circle(Plane=area.Centroid, Radius=division_2)
cir_2 = Circle(Plane=area.Centroid, Radius=division_3)
boundary = BoundarySurfaces(Edges=move_2.Geometry)
boundary_2 = BoundarySurfaces(Edges=cir)
rdiff = RegionDifference(CurvesA=boundary, CurvesB=boundary_2)
boundary_3 = BoundarySurfaces(Edges=rdiff)

# ----
addition = Addition(A=fastener_diameter, B="0.2")

division_4 = Division(A=approx_height, B=number_of_slats)
expression = Expression(x=division_4, Expression="(round(x * 10)) / 10")

# ---- group: Inputs (continued)
height_of_slats_cm = Panel(expression)

# ----
multiplication = Multiplication(A=height_of_slats_cm, B=number_of_slats)

# ---- group: Inputs (continued)
exact_full_height_cm = Panel(multiplication)

# ---- group: Slats
Z = UnitZ(Factor=height_of_slats_cm)
series = Series(Start="0", Step=height_of_slats_cm, Count=number_of_slats)
dom = ConstructDomain(DomainStart="0", DomainEnd=endplate_rotation)
extr = Extrude(Base=boundary_3, Direction=Z)
range = Range(Domain=dom, Steps=expr("x-1", number_of_slats))
Z_2 = UnitZ(Factor=series)
move_3 = Move(Geometry=extr, Motion=Z_2)  # -> Geometry, Transform
rotate = Rotate(Geometry=move_3.Geometry, Angle=degrees(range), Plane=area.Centroid)  # -> Geometry, Transform

# ---- group: Fasteners
division_5 = Division(A=edge_length, B=2)
division_6 = Division(A=edge_length, B=2)
X_2 = UnitX(Factor=expr("-x", division_5))
Y_2 = UnitY(Factor=expr("-x", division_5))
rectangle_2 = Rectangle(Plane=PlaneXY(0, 0, 0), XSize=edge_length, YSize=edge_length, Radius=0)  # -> Rectangle, Length
avr = Average(Input=[division_6, socket_diameter])
move_4 = Move(Geometry=rectangle_2.Rectangle, Motion=X_2)  # -> Geometry, Transform
move_5 = Move(Geometry=move_4.Geometry, Motion=Y_2)  # -> Geometry, Transform
Z_3 = UnitZ(Factor=exact_full_height_cm)
move_6 = Move(Geometry=move_5.Geometry, Motion=Z_3)  # -> Geometry, Transform
rotate_2 = Rotate(Geometry=move_6.Geometry, Angle=degrees(endplate_rotation), Plane=area.Centroid)  # -> Geometry, Transform
srfpt = SurfacePoints(Surface=rotate_2.Geometry)  # -> Points, Weights, Greville, UCount, VCount
shift = ShiftList(List=srfpt.Points, Shift=2, Wrap=True)
number_slider_4 = Slider(0, range=0..100)
number_slider_5 = Slider(0, range=0..100)
rev = ReverseList(List=srfpt.Points)
rev_2 = ReverseList(List=shift)
division_7 = Division(A=edge_length, B=2)
item = ListItem(List=rev, Index=number_slider_4, Wrap=True)
item_2 = ListItem(List=srfpt.Points, Index=number_slider_4, Wrap=True)
item_3 = ListItem(List=rev_2, Index=number_slider_5, Wrap=True)
area_2 = Area(Geometry=rotate_2.Geometry)  # -> Area, Centroid
item_4 = ListItem(List=shift, Index=number_slider_5, Wrap=True)
subtraction = Subtraction(A=division_7, B=number_slider)
ln = Line(StartPoint=item, EndPoint=item_2)
cir_3 = Circle(Plane=area_2.Centroid, Radius=subtraction)
ln_2 = Line(StartPoint=item_3, EndPoint=item_4)
ccx = CurveCurve(CurveA=[ln, ln_2], CurveB=cir_3)  # -> flatten(Points), ParamsA, ParamsB
division_8 = Division(A=fastener_diameter, B=2)
division_9 = Division(A=addition, B=2)
cyl = Cylinder(Base=ccx.Points, Radius=division_8, Length=expr("-x-1", exact_full_height_cm))
cyl_2 = Cylinder(Base=ccx.Points, Radius=division_8, Length=expr("-x", exact_full_height_cm))
sdiff = SolidDifference(BrepsA=rotate.Geometry, BrepsB=cyl)
cap = CapHoles(Brep=cyl_2)
sph = Sphere(Base=ccx.Points, Radius=division_9)

# ---- group: Plans
debrep = DeconstructBrep(Brep=sdiff)  # -> Faces, Edges, Vertices
item_5 = ListItem(List=debrep.Faces, Index="0", Wrap=True)  # -> flatten(Item)
panel = Panel(edge_length)
pt = ConstructPoint(XCoordinate=expr("x+2", panel), YCoordinate=expr("x+2", panel), ZCoordinate=0)
area_3 = Area(Geometry=item_5)  # -> Area, Centroid
edges = BrepEdges(Brep=item_5)  # -> Naked, Interior, NonManifold
recgrid = Rectangular(Plane=pt, SizeX=expr("x+1", panel), SizeY=expr("x+1", panel), ExtentX=number_slider_2, ExtentY=number_slider_3)  # -> Cells, flatten(Points)
pt_2 = Point(recgrid.Points)
short = ShortestList(ListA=area_3.Centroid, ListB=pt_2, TrimMode=2)  # -> ListA, ListB
ln_3 = Line(StartPoint=short.ListA, EndPoint=short.ListB)
vec2pt = Vector2Pt(PointA=short.ListA, PointB=short.ListB, Unitize=False)  # -> graft(Vector), Length
move_7 = Move(Geometry=edges.Naked, Motion=vec2pt.Vector)  # -> Geometry, Transform
item_6 = ListItem(List=move_7.Geometry, Index=0, Wrap=True)
area_4 = Area(Geometry=item_6)  # -> Area, Centroid
rotate_3 = Rotate(Geometry=move_7.Geometry, Angle=expr("-x", graft(degrees(range))), Plane=area_4.Centroid)  # -> Geometry, Transform

# ----
slats = CustomPreview(
    Geometry=sdiff,
    Material={diffuse=RGB(255, 255, 255), emission=RGB(0, 0, 0), shine=0, specular=RGB(255, 255, 255), transparency=0})
fasteners = CustomPreview(
    Geometry=[cap, sph],
    Material={diffuse=RGB(255, 255, 255), emission=RGB(0, 0, 0), shine=0, specular=RGB(255, 255, 255), transparency=0})
